# Dynamo graph ViewRange.dyn (Dynamo 2.10.1.3976)

select_plan_view = Views("LEVEL 1")  # graph input
select_ui = DSModelElementSelection()  # 1 picked in the model; graph input

# group: Get parameter value from family
getLocation = Element.GetLocation(element=select_ui)
Z = Point.Z(point=getLocation)
code_block = CodeBlock { "a"; "b"; "c"; }
a = Element.GetParameterValueByName(element=select_ui, parameterName=code_block.out0)
b = Element.GetParameterValueByName(element=select_ui, parameterName=code_block.out1)
c = Element.GetParameterValueByName(element=select_ui, parameterName=code_block.out2)

# group: Get Plan View Associated Level Elevation (for reference elevation)
level_categories = Categories("OST_Levels")
all_elements_of_category = ElementsOfCategory(Category=level_categories)
code_block_2 = CodeBlock { "Associated Level"; }
getParameterValueByName = Element.GetParameterValueByName(element=select_plan_view, parameterName=code_block_2)
name = Element.Name(element=all_elements_of_category)
eq = getParameterValueByName == name
filterByBoolMask = List.FilterByBoolMask(list=all_elements_of_category, mask=eq)
elevation = Level.Elevation(level=filterByBoolMask.in)

sub = Z - elevation
ref_elev_family_offset_value = CodeBlock(vDepth=sub, a=a, b=b, c=c) { vDepth; bottOff = vDepth+a; cutOff = bottOff+b; topOff = cutOff+c; }
set_view_range_python_script = Python(IN[0]=select_plan_view, IN[1]=ref_elev_family_offset_value.vDepth, IN[2]=ref_elev_family_offset_value.bottOff, IN[3]=ref_elev_family_offset_value.cutOff, IN[4]=ref_elev_family_offset_value.topOff)  # IronPython2
# ---------- set_view_range_python_script.python (40 lines) ----------
import clr
clr.AddReference('ProtoGeometry')
from Autodesk.DesignScript.Geometry import *

clr.AddReference('RevitAPI')
from Autodesk.Revit.DB import*

clr.AddReference('RevitServices')
from RevitServices.Persistence import DocumentManager
from RevitServices.Transactions import TransactionManager

doc = DocumentManager.Instance.CurrentDBDocument

#The inputs to this node will be stored as a list in the IN variables.
dataEnteringNode = IN

#Assign your output to the OUT variable.
v = UnwrapElement(IN[0])
depth = IN[1]
bottOff =IN[2]
cutOff = IN[3]
topOff = IN[4]

TransactionManager.Instance.EnsureInTransaction(doc)
vr = v.GetViewRange()

for d,bof,cof,tof in zip(depth,bottOff,cutOff,topOff):
	vr.SetOffset(PlanViewPlane.ViewDepthPlane,d)
	vr.SetOffset(PlanViewPlane.BottomClipPlane,bof)
	vr.SetOffset(PlanViewPlane.CutPlane,cof)
	vr.SetOffset(PlanViewPlane.TopClipPlane,tof)
	
v.SetViewRange(vr)
nd = vr.GetOffset(PlanViewPlane.ViewDepthPlane)
nb = vr.GetOffset(PlanViewPlane.BottomClipPlane)
nc = vr.GetOffset(PlanViewPlane.CutPlane)
nt = vr.GetOffset(PlanViewPlane.TopClipPlane)
TransactionManager.Instance.TransactionTaskDone()

OUT = [nd,nc,nc,nt] 
# ----------------------------------------
